# Grasshopper definition GenerateCase.gh (Grasshopper 1.0.7)
# plug-ins: Human

output_directory = Panel("C:\Users\tgerrish\Documents\GitHub\oshe\projects\KHALIDIYA")
material = Panel("""GND_SURROUNDING
MediumRough
0.2
1.73
2243
837
0.9
0.65
0""")
weatherfile = Panel("C:\Users\tgerrish\Documents\GitHub\oshe\projects\KHALIDIYA\UWG_ARE_AZ_Abu.Dhabi-Bateen.Exec.AP.412160_TMYx_URBAN_02.epw")
material_2 = Panel("""VEG_GHAF
VeryRough
0.05
0.01
0.5
150
0.9
0.7
0.7""")
material_3 = Panel("""SHD_SOLID
MediumRough
0.102
0.12
320
795
0.9
0.7
0""")
material_4 = Panel("""GND_ASPHALT
MediumRough
0.2
0.75
2360
920
0.93
0.87
0""")
material_5 = Panel("""GND_CONCRETE
MediumRough
0.2
1.73
2243
837
0.9
0.65
0""")
material_6 = Panel("""GND_WATER
MediumRough
0.2
1.4
1840
1480
0.95
0.8
0""")
material_7 = Panel("""GND_SAND
Rough
0.2
1.25
2100
810
0.88
0.7
0""")
material_8 = Panel("""BDG_CONTEXT
MediumRough
0.2032
1.95
2240
900
0.9
0.7
0""")
material_9 = Panel("""GND_STONE
MediumRough
0.2
2
2243
790
0.9
0.55
0""")
material_10 = Panel("""GND_GRASS
Rough
0.2
1
1250
1252
0.92
0.75
0""")
refreshall = Button()
ladybug = Ladybug_Ladybug()  # -> Vviiiiiiiiiizzz; plug-in component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
honeybee = Honeybee_Honeybee()  # -> Vviiiiiiiiiizzz; plug-in component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
e_executable_path = Panel("C:\openstudio-2.7.0\EnergyPlus\energyplus.exe")
toplayer = Data("KHALIDIYA")

# ---- group: GROUND SURFACES
python = GhPythonScript(Refresh=refreshall, MaterialPanel=material)  # -> LayerName, Roughness, Thickness, Conductivity, Density, SpecificHeat, ThermalAbsorptivity, SolarAbsorptivity, Porosity; inputs Refresh: Boolean, MaterialPanel: list
# ---------- python: Python ----------
if Refresh:
    pass

LayerName = str(MaterialPanel[0])
Roughness = str(MaterialPanel[1])
Thickness = float(MaterialPanel[2])
Conductivity = float(MaterialPanel[3])
Density = float(MaterialPanel[4])
SpecificHeat = float(MaterialPanel[5])
ThermalAbsorptivity = float(MaterialPanel[6])
SolarAbsorptivity = float(MaterialPanel[7])
Porosity = float(MaterialPanel[8])
# ---------- end python ----------
cluster = Cluster_3(solarabsorptivity=python.SolarAbsorptivity)
epopaquemat = Honeybee_EnergyPlusOpaqueMaterial(
    name=python.LayerName,
    roughness=python.Roughness,
    thickness=python.Thickness,
    conductivity=python.Conductivity,
    density=python.Density,
    specificHeat=python.SpecificHeat,
    thermAbsp=python.ThermalAbsorptivity,
    solAbsp=python.SolarAbsorptivity,
    visAbsp=python.SolarAbsorptivity)  # -> EPMaterial; plug-in component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
cluster_2 = Cluster(toplayer=toplayer, layername=python.LayerName)  # -> surfaces_2, surfacenames_2
radopaquemat = HoneybeePlus_RadianceOpaqueMaterial(name=graft(python.LayerName), reflect=graft(cluster), spec=0, rough=0)  # -> simplify(material); plug-in component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
epconstruction = Honeybee_EnergyPlusConstruction(name=python.LayerName, layer_1=epopaquemat)  # -> EPConstruction; plug-in component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
cluster_3 = Cluster_2(surfaces=cluster_2.surfaces_2)
createhbsrfs = Honeybee_createHBSrfs(geometry=cluster_2.surfaces_2, srfName=cluster_2.surfacenames_2, srfType="2", EPConstruction=epconstruction)  # -> readMe, simplify(flatten(HBSurface)); plug-in component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
hbsurface = HoneybeePlus_HoneybeeSurface(geo=cluster_2.surfaces_2, names=cluster_2.surfacenames_2, type="2", rad_mat=radopaquemat)  # -> report, flatten(HB_srf); plug-in component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
hb_srfs_radiance = Data(hbsurface.HB_srf)
reflectivity = Data(cluster)
hbsrfs_energyplus = Data(createhbsrfs.HBSurface)
boundaries = Data(flatten(cluster_3))

python_2 = GhPythonScript(Refresh=refreshall, MaterialPanel=material_9)  # -> LayerName, Roughness, Thickness, Conductivity, Density, SpecificHeat, ThermalAbsorptivity, SolarAbsorptivity, Porosity; inputs Refresh: Boolean, MaterialPanel: list; same code as python
cluster_4 = Cluster_3(solarabsorptivity=python_2.SolarAbsorptivity)
epopaquemat_2 = Honeybee_EnergyPlusOpaqueMaterial(
    name=python_2.LayerName,
    roughness=python_2.Roughness,
    thickness=python_2.Thickness,
    conductivity=python_2.Conductivity,
    density=python_2.Density,
    specificHeat=python_2.SpecificHeat,
    thermAbsp=python_2.ThermalAbsorptivity,
    solAbsp=python_2.SolarAbsorptivity,
    visAbsp=python_2.SolarAbsorptivity)  # -> EPMaterial; plug-in component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
cluster_5 = Cluster(toplayer=toplayer, layername=python_2.LayerName)  # -> surfaces_2, surfacenames_2
radopaquemat_2 = HoneybeePlus_RadianceOpaqueMaterial(name=graft(python_2.LayerName), reflect=graft(cluster_4), spec=0, rough=0)  # -> simplify(material); plug-in component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
epconstruction_2 = Honeybee_EnergyPlusConstruction(name=python_2.LayerName, layer_1=epopaquemat_2)  # -> EPConstruction; plug-in component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
cluster_6 = Cluster_2(surfaces=cluster_5.surfaces_2)
createhbsrfs_2 = Honeybee_createHBSrfs(geometry=cluster_5.surfaces_2, srfName=cluster_5.surfacenames_2, srfType="1", EPConstruction=epconstruction_2)  # -> readMe, simplify(flatten(HBSurface)); plug-in component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
hbsurface_2 = HoneybeePlus_HoneybeeSurface(geo=cluster_5.surfaces_2, names=cluster_5.surfacenames_2, type="1", rad_mat=radopaquemat_2)  # -> report, flatten(HB_srf); plug-in component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
hbsrfs_energyplus_2 = Data(createhbsrfs_2.HBSurface)
hb_srfs_radiance_2 = Data(hbsurface_2.HB_srf)
boundaries_2 = Data(flatten(cluster_6))
reflectivity_2 = Data(cluster_4)

# ----
python_3 = GhPythonScript(Refresh=refreshall, MaterialPanel=material_2)  # -> LayerName, Roughness, Thickness, Conductivity, Density, SpecificHeat, ThermalAbsorptivity, SolarAbsorptivity, Porosity; inputs Refresh: Boolean, MaterialPanel: list; same code as python
cluster_7 = Cluster(toplayer=toplayer, layername=python_3.LayerName)  # -> surfaces_2, surfacenames_2
constantschedule = Honeybee_ConstantSchedule(value=python_3.Porosity, scheduleName=python_3.LayerName)  # -> readMe, schedule, weekSched, schedIDFText; plug-in component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
radglassmaterial = Honeybee_RadianceGlassMaterial(
    materialName=python_3.LayerName,
    RTransmittance=python_3.Porosity,
    GTransmittance=python_3.Porosity,
    BTransmittance=python_3.Porosity,
    refractiveIndex=1.52)  # -> avrgTrans, RADMaterial; plug-in component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
radglassmat = HoneybeePlus_RadianceGlassMaterial(name=python_3.LayerName, t_vis=python_3.Porosity)  # -> material; plug-in component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
hb_epcontextsrf = HoneybeeEPContextSurfaces(
    shdSurfaces=flatten(cluster_7.surfaces_2),
    EPTransSchedule=constantschedule.schedule,
    RADMaterial=radglassmaterial.RADMaterial)  # -> HBContext; inputs shdSurfaces: list of Brep, justBoundingBox: Boolean
# ---------- hb_epcontextsrf: Python ----------
"""
prepare shading/context geometries

    Args:
        northVectorOrRotation: A vector that shows North or a number that shows
                               the rotation of the North from the Y axis
        bldgMasses: List of closed Breps as thermal zones.
    Returns:
        report: ...
        thermalZones: Thermal zone's geometries for visualiza
"""

ghenv.Component.Name = 'Honeybee EP context Surfaces'
ghenv.Component.NickName = 'HB_EPContextSrf'
ghenv.Component.Message = 'VER 0.0.64\nNOV_20_2018'
ghenv.Component.IconDisplayMode = ghenv.Component.IconDisplayMode.application
ghenv.Component.Category = "Honeybee"
ghenv.Component.SubCategory = "10 | Energy | Energy"
#compatibleHBVersion = VER 0.0.57\nNOV_04_2016
#compatibleLBVersion = VER 0.0.59\nFEB_01_2015
ghenv.Component.AdditionalHelpFromDocStrings = "2"

import rhinoscriptsyntax as rs
import Rhino as rc
import scriptcontext as sc
import os
import System
import Grasshopper.Kernel as gh
import uuid

tolerance = sc.doc.ModelAbsoluteTolerance
import math


def main(shdSurfaces, EPTransSchedule, meshingSettings, justBoundingBox):
    
    # import the classes
    if sc.sticky.has_key('honeybee_release'):

        try:
            if not sc.sticky['honeybee_release'].isCompatible(ghenv.Component): return -1
            if sc.sticky['honeybee_release'].isInputMissing(ghenv.Component): return -1
        except:
            warning = "You need a newer version of Honeybee to use this compoent." + \
            " Use updateHoneybee component to update userObjects.\n" + \
            "If you have already updated userObjects drag Honeybee_Honeybee component " + \
            "into canvas and try again."
            w = gh.GH_RuntimeMessageLevel.Warning
            ghenv.Component.AddRuntimeMessage(w, warning)
            return -1
        
        # don't customize this part
        hb_EPSrf = sc.sticky["honeybee_EPSurface"]
        hb_EPSHDSurface = sc.sticky["honeybee_EPShdSurface"]
        hb_RADMaterialAUX = sc.sticky["honeybee_RADMaterialAUX"]
        hb_EPObjectsAux = sc.sticky["honeybee_EPObjectsAUX"]()
        HBScheduleList = sc.sticky["honeybee_ScheduleLib"].keys()

        ########################################################################
        #----------------------------------------------------------------------#
        shdBreps = []
        # create bounding box of shading geometries
        if justBoundingBox:
            for brep in shdSurfaces:
                if brep.Faces.Count>1 or not brep.Faces[0].IsPlanar(sc.doc.ModelAbsoluteTolerance):
                    shdBreps.append(brep.GetBoundingBox(True).ToBrep())
                else:
                    shdBreps.append(brep)
        else:
            shdBreps = shdSurfaces
        
        shadingClasses = []
        shadingMeshPreview = []
        
        if meshingSettings == None:
            mp = rc.Geometry.MeshingParameters.Minimal
            mp.SimplePlanes = True
        else:
            mp = meshingSettings
        
        def getRadMaterialName(radMaterial):
            nameStr = radMaterial.split(" ")[2]
            name =  nameStr.split("\n")[0]
            return name
        
        for brepCount, brep in enumerate(shdBreps):
            if brep != None:
                isPlanar = True
                # check planarity
                for face in brep.Faces:
                    if not face.IsPlanar(tolerance):
                        isPlanar = False
                        break
                
                shadingBreps = []
                if not isPlanar:
                    meshArray = rc.Geometry.Mesh.CreateFromBrep(brep, mp)
                    for mesh in meshArray:
                        for meshFace in range(mesh.Faces.Count):
                            vertices = list(mesh.Faces.GetFaceVertices(meshFace))[1:]
                            vertices = vertices + [sc.doc.ModelAbsoluteTolerance]
                            # create the brep from mesh
                            shdBrep = rc.Geometry.Brep.CreateFromCornerPoints(*vertices)
                            shadingBreps.append(shdBrep)
                else:
                    for face in brep.Faces:
                        shadingBreps.append(face.DuplicateFace(False))
                
                for faceCount, shdBrep in enumerate(shadingBreps):
                        thisShading = hb_EPSHDSurface(shdBrep, 1000*brepCount + faceCount, 'shdSrf_' + `brepCount` + '_' + `faceCount` + "_" + str(uuid.uuid4()))
                        
                        # add transmittance schedule if any
                        if EPTransSchedule!=None:
                            schedule= EPTransSchedule.upper()
                            if schedule!=None and not schedule.lower().endswith(".csv") and schedule not in HBScheduleList:
                                msg = "Cannot find " + schedule + " in Honeybee schedule library."
                                print msg
                                ghenv.Component.AddRuntimeMessage(gh.GH_RuntimeMessageLevel.Warning, msg)
                                return -1
                            elif schedule!=None and schedule.lower().endswith(".csv"):
                                # check if csv file is existed
                                if not os.path.isfile(schedule):
                                    msg = "Cannot find the shchedule file: " + schedule
                                    print msg
                                    ghenv.Component.AddRuntimeMessage(gh.GH_RuntimeMessageLevel.Warning, msg)
                                    return -1
                            
                            thisShading.TransmittanceSCH = schedule
                        
                        # add the Rad Material if any
                        if RADMaterial!=None:
                            # if it is just the name of the material make sure it is already defined
                            if len(RADMaterial.split(" ")) == 1:
                                # if the material is not in the library add it to the library
                                if not hb_RADMaterialAUX.isMatrialExistInLibrary(RADMaterial):
                                    warningMsg = "Can't find " + RADMaterial + " in RAD Material Library.\n" + \
                                                "Add the material to the library and try again."
                                    ghenv.Component.AddRuntimeMessage(gh.GH_RuntimeMessageLevel.Warning, warningMsg)
                                    return
                                
                                try:
                                    thisShading.setRADMaterial(RADMaterial)
                                except Exception, e:
                                    print e
                                    warningMsg = "You are using an old version of Honeybee_Honeybee! Update your files and try again."
                                    print warningMsg
                                    ghenv.Component.AddRuntimeMessage(gh.GH_RuntimeMessageLevel.Warning, warningMsg)
                                    return
                                
                                addedToLib = True
                            else:
                                
                                # try to add the material to the library
                                addedToLib, thisShading.RadMaterial = hb_RADMaterialAUX.analyseRadMaterials(RADMaterial, True)
                                
                            if addedToLib==False:
                                warningMsg = "Failed to add " + RADMaterial + " to the Library."
                                ghenv.Component.AddRuntimeMessage(gh.GH_RuntimeMessageLevel.Warning, warningMsg)
                                return
                        
                        # add shading to the list
                        shadingClasses.append(thisShading)
                
        # add to the hive
        hb_hive = sc.sticky["honeybee_Hive"]()
        HBContext  = hb_hive.addToHoneybeeHive(shadingClasses, ghenv.Component)
        return HBContext
        ################################################################################################
    else:
        print "You should first let Honeybee to fly..."
        w = gh.GH_RuntimeMessageLevel.Warning
        ghenv.Component.AddRuntimeMessage(w, "You should first let Honeybee to fly...")
        return -1
        

if _shdSurfaces and _shdSurfaces[0]!=None:
    # add cleaning function
    result= main(_shdSurfaces, EPTransSchedule_, meshingSettings_, justBoundingBox_)
    
    if result != -1: HBContext = result
# ---------- end hb_epcontextsrf ----------
hbsurface_3 = HoneybeePlus_HoneybeeSurface(geo=cluster_7.surfaces_2, type="6", rad_mat=radglassmat)  # -> report, flatten(HB_srf); plug-in component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
hbcontextsrfs_energyplus = Data(hb_epcontextsrf)
hb_srfs_radiance_3 = Data(hbsurface_3.HB_srf)

python_4 = GhPythonScript(Refresh=refreshall, MaterialPanel=material_3)  # -> LayerName, Roughness, Thickness, Conductivity, Density, SpecificHeat, ThermalAbsorptivity, SolarAbsorptivity, Porosity; inputs Refresh: Boolean, MaterialPanel: list; same code as python
cluster_8 = Cluster(toplayer=toplayer, layername=python_4.LayerName)  # -> surfaces_2, surfacenames_2
constantschedule_2 = Honeybee_ConstantSchedule(value=python_4.Porosity, scheduleName=python_4.LayerName)  # -> readMe, schedule, weekSched, schedIDFText; plug-in component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
radglassmaterial_2 = Honeybee_RadianceGlassMaterial(
    materialName=python_4.LayerName,
    RTransmittance=python_4.Porosity,
    GTransmittance=python_4.Porosity,
    BTransmittance=python_4.Porosity,
    refractiveIndex=1.52)  # -> avrgTrans, RADMaterial; plug-in component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
radglassmat_2 = HoneybeePlus_RadianceGlassMaterial(name=python_4.LayerName, t_vis=python_4.Porosity)  # -> material; plug-in component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
hb_epcontextsrf_2 = HoneybeeEPContextSurfaces(
    shdSurfaces=flatten(cluster_8.surfaces_2),
    EPTransSchedule=constantschedule_2.schedule,
    RADMaterial=radglassmaterial_2.RADMaterial)  # -> HBContext; inputs shdSurfaces: list of Brep, justBoundingBox: Boolean; same code as hb_epcontextsrf
hbsurface_4 = HoneybeePlus_HoneybeeSurface(geo=cluster_8.surfaces_2, type="6", rad_mat=radglassmat_2)  # -> report, flatten(HB_srf); plug-in component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
hbcontextsrfs_energyplus_2 = Data(hb_epcontextsrf_2)
hb_srfs_radiance_4 = Data(hbsurface_4.HB_srf)

# ---- group: GROUND SURFACES
python_5 = GhPythonScript(Refresh=refreshall, MaterialPanel=material_7)  # -> LayerName, Roughness, Thickness, Conductivity, Density, SpecificHeat, ThermalAbsorptivity, SolarAbsorptivity, Porosity; inputs Refresh: Boolean, MaterialPanel: list; same code as python
cluster_9 = Cluster_3(solarabsorptivity=python_5.SolarAbsorptivity)
epopaquemat_3 = Honeybee_EnergyPlusOpaqueMaterial(
    name=python_5.LayerName,
    roughness=python_5.Roughness,
    thickness=python_5.Thickness,
    conductivity=python_5.Conductivity,
    density=python_5.Density,
    specificHeat=python_5.SpecificHeat,
    thermAbsp=python_5.ThermalAbsorptivity,
    solAbsp=python_5.SolarAbsorptivity,
    visAbsp=python_5.SolarAbsorptivity)  # -> EPMaterial; plug-in component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
cluster_10 = Cluster(toplayer=toplayer, layername=python_5.LayerName)  # -> surfaces_2, surfacenames_2
radopaquemat_3 = HoneybeePlus_RadianceOpaqueMaterial(name=graft(python_5.LayerName), reflect=graft(cluster_9), spec=0, rough=0)  # -> simplify(material); plug-in component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
epconstruction_3 = Honeybee_EnergyPlusConstruction(name=python_5.LayerName, layer_1=epopaquemat_3)  # -> EPConstruction; plug-in component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
cluster_11 = Cluster_2(surfaces=cluster_10.surfaces_2)
createhbsrfs_3 = Honeybee_createHBSrfs(geometry=cluster_10.surfaces_2, srfName=cluster_10.surfacenames_2, srfType="1", EPConstruction=epconstruction_3)  # -> readMe, simplify(flatten(HBSurface)); plug-in component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
hbsurface_5 = HoneybeePlus_HoneybeeSurface(geo=cluster_10.surfaces_2, names=cluster_10.surfacenames_2, type="1", rad_mat=radopaquemat_3)  # -> report, flatten(HB_srf); plug-in component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
hbsrfs_energyplus_3 = Data(createhbsrfs_3.HBSurface)
hb_srfs_radiance_5 = Data(hbsurface_5.HB_srf)
boundaries_3 = Data(flatten(cluster_11))
reflectivity_3 = Data(cluster_9)

python_6 = GhPythonScript(Refresh=refreshall, MaterialPanel=material_4)  # -> LayerName, Roughness, Thickness, Conductivity, Density, SpecificHeat, ThermalAbsorptivity, SolarAbsorptivity, Porosity; inputs Refresh: Boolean, MaterialPanel: list; same code as python
cluster_12 = Cluster_3(solarabsorptivity=python_6.SolarAbsorptivity)
epopaquemat_4 = Honeybee_EnergyPlusOpaqueMaterial(
    name=python_6.LayerName,
    roughness=python_6.Roughness,
    thickness=python_6.Thickness,
    conductivity=python_6.Conductivity,
    density=python_6.Density,
    specificHeat=python_6.SpecificHeat,
    thermAbsp=python_6.ThermalAbsorptivity,
    solAbsp=python_6.SolarAbsorptivity,
    visAbsp=python_6.SolarAbsorptivity)  # -> EPMaterial; plug-in component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
cluster_13 = Cluster(toplayer=toplayer, layername=python_6.LayerName)  # -> surfaces_2, surfacenames_2
radopaquemat_4 = HoneybeePlus_RadianceOpaqueMaterial(name=graft(python_6.LayerName), reflect=graft(cluster_12), spec=0, rough=0)  # -> simplify(material); plug-in component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
epconstruction_4 = Honeybee_EnergyPlusConstruction(name=python_6.LayerName, layer_1=epopaquemat_4)  # -> EPConstruction; plug-in component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
cluster_14 = Cluster_2(surfaces=cluster_13.surfaces_2)
createhbsrfs_4 = Honeybee_createHBSrfs(geometry=cluster_13.surfaces_2, srfName=cluster_13.surfacenames_2, srfType="1", EPConstruction=epconstruction_4)  # -> readMe, simplify(flatten(HBSurface)); plug-in component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
hbsurface_6 = HoneybeePlus_HoneybeeSurface(geo=cluster_13.surfaces_2, names=cluster_13.surfacenames_2, type="1", rad_mat=radopaquemat_4)  # -> report, flatten(HB_srf); plug-in component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
hbsrfs_energyplus_4 = Data(createhbsrfs_4.HBSurface)
hb_srfs_radiance_6 = Data(hbsurface_6.HB_srf)
boundaries_4 = Data(flatten(cluster_14))
reflectivity_4 = Data(cluster_12)

python_7 = GhPythonScript(Refresh=refreshall, MaterialPanel=material_10)  # -> LayerName, Roughness, Thickness, Conductivity, Density, SpecificHeat, ThermalAbsorptivity, SolarAbsorptivity, Porosity; inputs Refresh: Boolean, MaterialPanel: list; same code as python
cluster_15 = Cluster_3(solarabsorptivity=python_7.SolarAbsorptivity)
epopaquemat_5 = Honeybee_EnergyPlusOpaqueMaterial(
    name=python_7.LayerName,
    roughness=python_7.Roughness,
    thickness=python_7.Thickness,
    conductivity=python_7.Conductivity,
    density=python_7.Density,
    specificHeat=python_7.SpecificHeat,
    thermAbsp=python_7.ThermalAbsorptivity,
    solAbsp=python_7.SolarAbsorptivity,
    visAbsp=python_7.SolarAbsorptivity)  # -> EPMaterial; plug-in component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
cluster_16 = Cluster(toplayer=toplayer, layername=python_7.LayerName)  # -> surfaces_2, surfacenames_2
radopaquemat_5 = HoneybeePlus_RadianceOpaqueMaterial(name=graft(python_7.LayerName), reflect=graft(cluster_15), spec=0, rough=0)  # -> simplify(material); plug-in component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
epconstruction_5 = Honeybee_EnergyPlusConstruction(name=python_7.LayerName, layer_1=epopaquemat_5)  # -> EPConstruction; plug-in component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
cluster_17 = Cluster_2(surfaces=cluster_16.surfaces_2)
createhbsrfs_5 = Honeybee_createHBSrfs(geometry=cluster_16.surfaces_2, srfName=cluster_16.surfacenames_2, srfType="1", EPConstruction=epconstruction_5)  # -> readMe, simplify(flatten(HBSurface)); plug-in component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
hbsurface_7 = HoneybeePlus_HoneybeeSurface(geo=cluster_16.surfaces_2, names=cluster_16.surfacenames_2, type="1", rad_mat=radopaquemat_5)  # -> report, flatten(HB_srf); plug-in component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
hbsrfs_energyplus_5 = Data(createhbsrfs_5.HBSurface)
hb_srfs_radiance_7 = Data(hbsurface_7.HB_srf)
boundaries_5 = Data(flatten(cluster_17))
reflectivity_5 = Data(cluster_15)

python_8 = GhPythonScript(Refresh=refreshall, MaterialPanel=material_6)  # -> LayerName, Roughness, Thickness, Conductivity, Density, SpecificHeat, ThermalAbsorptivity, SolarAbsorptivity, Porosity; inputs Refresh: Boolean, MaterialPanel: list; same code as python
cluster_18 = Cluster_3(solarabsorptivity=python_8.SolarAbsorptivity)
epopaquemat_6 = Honeybee_EnergyPlusOpaqueMaterial(
    name=python_8.LayerName,
    roughness=python_8.Roughness,
    thickness=python_8.Thickness,
    conductivity=python_8.Conductivity,
    density=python_8.Density,
    specificHeat=python_8.SpecificHeat,
    thermAbsp=python_8.ThermalAbsorptivity,
    solAbsp=python_8.SolarAbsorptivity,
    visAbsp=python_8.SolarAbsorptivity)  # -> EPMaterial; plug-in component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
cluster_19 = Cluster(toplayer=toplayer, layername=python_8.LayerName)  # -> surfaces_2, surfacenames_2
radopaquemat_6 = HoneybeePlus_RadianceOpaqueMaterial(name=graft(python_8.LayerName), reflect=graft(cluster_18), spec=0, rough=0)  # -> simplify(material); plug-in component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
epconstruction_6 = Honeybee_EnergyPlusConstruction(name=python_8.LayerName, layer_1=epopaquemat_6)  # -> EPConstruction; plug-in component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
cluster_20 = Cluster_2(surfaces=cluster_19.surfaces_2)
createhbsrfs_6 = Honeybee_createHBSrfs(geometry=cluster_19.surfaces_2, srfName=cluster_19.surfacenames_2, srfType="1", EPConstruction=epconstruction_6)  # -> readMe, simplify(flatten(HBSurface)); plug-in component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
hbsurface_8 = HoneybeePlus_HoneybeeSurface(geo=cluster_19.surfaces_2, names=cluster_19.surfacenames_2, type="1", rad_mat=radopaquemat_6)  # -> report, flatten(HB_srf); plug-in component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
hbsrfs_energyplus_6 = Data(createhbsrfs_6.HBSurface)
hb_srfs_radiance_8 = Data(hbsurface_8.HB_srf)
reflectivity_6 = Data(cluster_18)
boundaries_6 = Data(flatten(cluster_20))

# ---- group: CONTEXT BUILDING MASSES
python_9 = GhPythonScript(Refresh=refreshall, MaterialPanel=material_8)  # -> LayerName, Roughness, Thickness, Conductivity, Density, SpecificHeat, ThermalAbsorptivity, SolarAbsorptivity, Porosity; inputs Refresh: Boolean, MaterialPanel: list; same code as python
cluster_21 = Cluster_4(toplayer=toplayer, layername=python_9.LayerName)  # -> brep_2, brepnames_2
cluster_22 = Cluster_3(solarabsorptivity=python_9.SolarAbsorptivity)
epopaquemat_7 = Honeybee_EnergyPlusOpaqueMaterial(
    name=python_9.LayerName,
    roughness=python_9.Roughness,
    thickness=python_9.Thickness,
    conductivity=python_9.Conductivity,
    density=python_9.Density,
    specificHeat=python_9.SpecificHeat,
    thermAbsp=python_9.ThermalAbsorptivity,
    solAbsp=python_9.SolarAbsorptivity,
    visAbsp=python_9.SolarAbsorptivity)  # -> EPMaterial; plug-in component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
debrep = DeconstructBrep(Brep=cluster_21.brep_2)  # -> flatten(Faces), Edges, Vertices
lng = ListLength(List=debrep.Faces)
mass2zone = Honeybee_Masses2Zones(zoneMasses=flatten(cluster_21.brep_2), zoneNames=cluster_21.brepnames_2, maxRoofAngle=30, createHBZones=Toggle(True))  # -> readMe, HBZones; plug-in component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
radopaquemat_7 = HoneybeePlus_RadianceOpaqueMaterial(reflect=graft(cluster_22), spec=0, rough=0)  # -> simplify(material); plug-in component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
epconstruction_7 = Honeybee_EnergyPlusConstruction(name=python_9.LayerName, layer_1=epopaquemat_7)  # -> EPConstruction; plug-in component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
series = Series(Start=0, Step=1, Count=lng)
concat = Concatenate(FragmentB=series)
setepzonecnstr = Honeybee_SetEPZoneConstruction(
    HBZones=flatten(mass2zone.HBZones),
    wallEPConstruction=epconstruction_7,
    roofEPConstruction=epconstruction_7,
    floorEPConstruction=epconstruction_7,
    expFloorEPConstruction=epconstruction_7)  # -> simplify(modifiedHBZones); plug-in component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
hbsurface_9 = HoneybeePlus_HoneybeeSurface(geo=debrep.Faces, names=concat, type="0", rad_mat=radopaquemat_7)  # -> report, flatten(HB_srf); plug-in component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
hbzones_energyplus = Data(setepzonecnstr)
hb_srfs_radiance_9 = Data(hbsurface_9.HB_srf)

# ---- group: GROUND SURFACES
python_10 = GhPythonScript(Refresh=refreshall, MaterialPanel=material_5)  # -> LayerName, Roughness, Thickness, Conductivity, Density, SpecificHeat, ThermalAbsorptivity, SolarAbsorptivity, Porosity; inputs Refresh: Boolean, MaterialPanel: list; same code as python
cluster_23 = Cluster_3(solarabsorptivity=python_10.SolarAbsorptivity)
epopaquemat_8 = Honeybee_EnergyPlusOpaqueMaterial(
    name=python_10.LayerName,
    roughness=python_10.Roughness,
    thickness=python_10.Thickness,
    conductivity=python_10.Conductivity,
    density=python_10.Density,
    specificHeat=python_10.SpecificHeat,
    thermAbsp=python_10.ThermalAbsorptivity,
    solAbsp=python_10.SolarAbsorptivity,
    visAbsp=python_10.SolarAbsorptivity)  # -> EPMaterial; plug-in component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
cluster_24 = Cluster(toplayer=toplayer, layername=python_10.LayerName)  # -> surfaces_2, surfacenames_2
radopaquemat_8 = HoneybeePlus_RadianceOpaqueMaterial(name=graft(python_10.LayerName), reflect=graft(cluster_23), spec=0, rough=0)  # -> simplify(material); plug-in component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
epconstruction_8 = Honeybee_EnergyPlusConstruction(name=python_10.LayerName, layer_1=epopaquemat_8)  # -> EPConstruction; plug-in component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
cluster_25 = Cluster_2(surfaces=cluster_24.surfaces_2)
createhbsrfs_7 = Honeybee_createHBSrfs(geometry=cluster_24.surfaces_2, srfName=cluster_24.surfacenames_2, srfType="1", EPConstruction=epconstruction_8)  # -> readMe, simplify(flatten(HBSurface)); plug-in component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
hbsurface_10 = HoneybeePlus_HoneybeeSurface(geo=cluster_24.surfaces_2, names=cluster_24.surfacenames_2, type="1", rad_mat=radopaquemat_8)  # -> report, flatten(HB_srf); plug-in component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
hbsrfs_energyplus_7 = Data(createhbsrfs_7.HBSurface)
hb_srfs_radiance_10 = Data(hbsurface_10.HB_srf)
boundaries_7 = Data(flatten(cluster_25))
reflectivity_7 = Data(cluster_23)

# ----
makeadiabatic = Honeybee_MakeAdiabatic(HBSrfs=createhbsrfs.HBSurface)  # -> HBSrfs; plug-in component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

# ---- group: ANALYSIS POINTS
concat_2 = Concatenate(FragmentA=toplayer, FragmentC="::", FragmentB="ANALYSIS_REGION")
concat_3 = Concatenate(FragmentA=toplayer, FragmentC="::", FragmentB="ANALYSIS_PLANE")
dpipeline = DynamicGeometryPipeline(
    LayerFilter=concat_2,
    TypeFilter="Brep",
    NameFilter="*",
    GroupByLayer=False,
    GroupByType=False,
    IncludeHidden=True,
    IncludeLocked=True,
    enableFullPath=True,
    listenToAttributes=True)  # -> simplify(GeometryOut)
dpipeline_2 = DynamicGeometryPipeline(
    LayerFilter=concat_3,
    TypeFilter="Brep",
    NameFilter="*",
    GroupByLayer=False,
    GroupByType=False,
    IncludeHidden=True,
    IncludeLocked=True,
    enableFullPath=True,
    listenToAttributes=True)  # -> simplify(GeometryOut)
edges = BrepEdges(Brep=dpipeline)  # -> Naked, Interior, NonManifold
Z = UnitZ(Factor="100")
move = Move(Geometry=dpipeline, Motion=Z)  # -> Geometry, Transform
join = JoinCurves(Curves=edges.Naked, Preserve=False)
cp = ControlPoints(Curve=join)  # -> flatten(Points), Weights, Knots
genpts = Ladybug_GeneratePointGrid(geometry=move.Geometry, grid_size="1.5", dist_surface="0")  # -> flatten(points), flatten(vectors), flatten(face_areas), mesh; plug-in component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
lng_2 = ListLength(List=cp.Points)
subtraction = Subtraction(A=lng_2, B="1")
project = ProjectPoint(Point=genpts.points, Direction=Vector(0, 0, -1), Geometry=dpipeline_2)  # -> Point, Index
split = SplitList(List=cp.Points, Index=subtraction)  # -> ListA, ListB

# ----
panel = Panel("""FAMILYPARK2 = 1.25
FAMILYPARK1 = 1.2
AirportRd_P1 = 1.6
AirportRd_P2 = 0.675
AirportRd_P3 = 1
Khalidiya = 1.5""")

# ---- group: ANALYSIS POINT GROUND REFLECTIVITIES
entwine = Entwine(
    Branch01=reflectivity_4,
    Branch02=reflectivity_3,
    Branch03=reflectivity_7,
    Branch04=reflectivity_5,
    Branch05=reflectivity_2,
    Branch08=reflectivity_6,
    FlattenInputs=True)  # -> simplify(flatten(Result))
entwine_2 = Entwine(
    Branch01=boundaries_4,
    Branch02=boundaries_3,
    Branch03=boundaries_7,
    Branch04=boundaries_5,
    Branch05=boundaries_2,
    Branch08=boundaries_6,
    FlattenInputs=True)  # -> simplify(Result)
null = NullItem(Item=entwine_2)  # -> NullFlags, InvalidFlags, Description
toggle = BooleanToggle(True)
cull = CullPattern(List=entwine_2, CullPattern=invert(null.InvalidFlags))
ma = MassAddition(Input=null.InvalidFlags)  # -> flatten(Result), PartialResults
equals = Equality(FirstNumber="0", SecondNumber=ma.Result)  # -> Equality, Inequality
clean = CleanTree(RemoveNulls=toggle, RemoveInvalid=toggle, RemoveEmpty=toggle, Tree=cull)
dispatch = Dispatch(List=entwine, DispatchPattern=flatten(equals.Equality))  # -> ListA, ListB
project_2 = Project(Geometry=clean, Plane=PlaneXY(0, 0, 0))  # -> Geometry, Transform
incurve = PointInCurve(Point=project.Point, Curve=graft(project_2.Geometry))  # -> simplify(Relationship), Point
lng_3 = ListLength(List=project_2.Geometry)  # -> flatten(Length)
dup = DuplicateData(Data=graft(dispatch.ListA), Number=graft(lng_3), Order=True)  # -> flatten(Data)
larger = LargerThan(FirstNumber=incurve.Relationship, SecondNumber="1")  # -> LargerThan, OrEqualTo
dispatch_2 = Dispatch(List=project.Point, DispatchPattern=larger.OrEqualTo)  # -> simplify(ListA), ListB
lng_4 = ListLength(List=simplify(dispatch_2.ListA))
dup_2 = DuplicateData(Data=simplify(graft(dup)), Number=simplify(graft(lng_4)), Order=True)

# ----
toggle_2 = BooleanToggle(True)  # disabled
list = ValueList({"Per tree": 1, "Per branch": 2}, selected="Per tree")  # disabled
list_2 = ValueList({"Demo": 1, "User tree": 2}, selected="User tree")  # disabled
c_script = CSharpScript(enable=toggle_2, mode=list_2, userTree=dispatch_2.ListA, uniqueMode=list)  # -> out, Elapsed, uniquePtsTree, duplicatePtsTree, duplicatePtsRemovedTree; inputs enable: Boolean, mode: Int32, userTree: tree of Point3d, count: Int32, branchItems: Int32, decimals: Int32, scale: Double, dupliMin: Int32, dupliMax: Int32, uniqueMode: Int32; disabled
# ---------- c_script: C# ----------
    // by The Lord of Darkness due to critical Tequila starvation issues (Vodka is the solution).

    System.Diagnostics.Stopwatch sw = new System.Diagnostics.Stopwatch();
    sw.Start();

    //-------------------------------------------------------------- better safe than sorry
    if(!enable)return;
    List<Point3d> userPts = userTree.AllData().ToList();
    userPts = userPts.Where(x => x != Point3d.Unset).ToList();

    //-------------------------------------------------------------- better safe than sorry
    if(mode == 2 && !userPts.Any()){Print(" "); Print("No user data: Demo ON"); mode = 1;}
    DataTree<Point3d> dupesRemovedTree = new DataTree<Point3d>();
    UM = uniqueMode;

    if(mode == 1){
      DataTree<Point3d> dupesTree = new DataTree<Point3d>();
      DataTree<Point3d> uniTree = new DataTree<Point3d>();
      Random rnd = new Random();
      int D = decimals;
      MakeDemoTrees(ref dupesTree, ref uniTree, rnd, D, count, branchItems, scale, dupliMin, dupliMax);

      uniquePtsTree = uniTree;      //>>out
      duplicatePtsTree = dupesTree; //>>out

      RemoveDupes(dupesTree, ref dupesRemovedTree);
      duplicatePtsRemovedTree = dupesRemovedTree; //>>out

      Print(" ");
      Print("Made: {0} unique pts in {1} branches", uniTree.DataCount, uniTree.BranchCount);
      Print(" ");
      Print("Made: {0} dupe/unique pts in {1} branches", dupesTree.DataCount, dupesTree.BranchCount);
      Print("Dupes removal: {0} unique pts in {1} branches", dupesRemovedTree.DataCount, dupesRemovedTree.BranchCount);
    }
    else{
      Print(" ");
      Print("UserTree WARNING No unique pts check");

      uniquePtsTree = userTree;      //>>out
      RemoveDupes(userTree, ref dupesRemovedTree);
      duplicatePtsRemovedTree = dupesRemovedTree; //>>out

      Print(" ");
      Print("UserTree: {0} pts in {1} branches", userTree.DataCount, userTree.BranchCount);
      Print("Dupes removal: {0} unique pts in {1} branches", dupesRemovedTree.DataCount, dupesRemovedTree.BranchCount);
    }

    sw.Stop();
    Elapsed = (string.Format("Elapsed: {0}ms", sw.Elapsed.TotalMilliseconds));
# ---------- c_script: C# additional code ----------
  private void MakeDemoTrees(ref DataTree<Point3d> dupesTree, ref DataTree<Point3d> uniTree,
  Random rnd, int D, int count, int branchItems, double scale, int dupliMin, int dupliMax){

    int items = 0;
    int branch = 0;
    HashSet<Point3d> unique = new HashSet<Point3d>();

    for(int i = 0; i < count; i++){
      int hashCount = unique.Count;
      Point3d p = new Point3d(Math.Round((rnd.NextDouble() * scale), D), Math.Round((rnd.NextDouble() * scale), D), Math.Round((rnd.NextDouble() * scale), D));
      unique.Add(p);
      if(hashCount < unique.Count){
        uniTree.Add(p, new GH_Path(branch));
        for(int j = 0; j < rnd.Next(dupliMin, dupliMax);j++){
          dupesTree.Add(p, new GH_Path(branch));
        }
        items++;
        if(items >= branchItems){ branch++; items = 0;}
      }
    }
  }

  public int UM; // unique mode, that is (per tree [1] or per branch [2])

  private void RemoveDupes(DataTree<Point3d> inputTree, ref DataTree<Point3d> outputTree){
    HashSet<Point3d> unique = new HashSet<Point3d>();
    foreach(GH_Path path in inputTree.Paths){
      List<Point3d> pts = inputTree.Branch(path).ToList();
      foreach(Point3d p in pts){
        int hashCount = unique.Count;
        unique.Add(p);
        if(hashCount < unique.Count){
          outputTree.Add(p, new GH_Path(path));
        }
      }
      if(UM == 2) unique.Clear();
    }
  }
# ---------- end c_script ----------
merge = Merge(
    Data2=hbsrfs_energyplus_4,
    Data3=hbsrfs_energyplus_3,
    Data4=hbsrfs_energyplus_7,
    Data5=hbsrfs_energyplus_5,
    Data6=hbsrfs_energyplus_2,
    Data9=hbsrfs_energyplus_6,
    Data10=hbsrfs_energyplus)  # -> flatten(Result)
merge_2 = Merge(
    Data1=hb_srfs_radiance_9,
    Data3=hb_srfs_radiance_6,
    Data4=hb_srfs_radiance_5,
    Data5=hb_srfs_radiance_10,
    Data6=hb_srfs_radiance_7,
    Data7=hb_srfs_radiance_2,
    Data10=hb_srfs_radiance_8,
    Data11=hb_srfs_radiance,
    Data15=hb_srfs_radiance_4,
    Data19=hb_srfs_radiance_3)  # -> flatten(Result)
merge_3 = Merge(Data2=hbcontextsrfs_energyplus_2, Data6=hbcontextsrfs_energyplus)  # -> flatten(Result)
toggle_3 = BooleanToggle(True)
toggle_4 = BooleanToggle(True)
toggle_5 = BooleanToggle(True)
groundsurfacereflectivities = Data(flatten(dup_2))
analysispoints = Point(flatten(dispatch_2.ListA))
boundarypoints = Point(flatten(split.ListA))
clean_2 = CleanTree(RemoveNulls=toggle_3, RemoveInvalid=toggle_3, RemoveEmpty=toggle_3, Tree=merge)
clean_3 = CleanTree(RemoveNulls=toggle_4, RemoveInvalid=toggle_4, RemoveEmpty=toggle_4, Tree=merge_3)
clean_4 = CleanTree(RemoveNulls=toggle_5, RemoveInvalid=toggle_5, RemoveEmpty=toggle_5, Tree=merge_2)
createhbzones = Honeybee_createHBZones(name="GROUND_ZONE", HBSurfaces=flatten(clean_2), isConditioned=Toggle(False))  # -> readMe, HBZone; plug-in component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
toggle_6 = BooleanToggle(True)
hbcontext = Data(flatten(clean_3))
hb_srfs = Data(flatten(clean_4))
clean_5 = CleanTree(RemoveNulls=toggle_6, RemoveInvalid=toggle_6, RemoveEmpty=toggle_6, Tree=[createhbzones.HBZone, hbzones_energyplus])
hbzones = Data(flatten(clean_5))
isconvex = Honeybee_FindNonConvex(breps=hbzones)  # -> readMe, nonConvex, faultyGeometry; plug-in component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
toggle_7 = BooleanToggle(True)
runradiancefilegeneration = Boolean(toggle_7)

# ---- group: Generate Radiance sample point incident radiation model
wea = HoneybeePlus_WEAFromEPW(epw_file=weatherfile)  # -> wea; plug-in component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
analysisgrid = HoneybeePlus_AnalysisGrid(test_points=analysispoints)  # -> analysis_grid; plug-in component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
skymatrix = HoneybeePlus_SkyMatrix(north=0, wea=wea, density=1)  # -> skymtx; plug-in component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
annualdlrecipe = HoneybeePlus_AnnualDaylightRecipe(skymtx=skymatrix, analysis_grids=analysisgrid, analysis_type="1", reuse_dmtx=Toggle(True))  # -> analysis_recipe; plug-in component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
runradiance = HoneybeePlus_RunRadianceAnalysis(
    analysis_recipe=annualdlrecipe,
    HB_objects=flatten(hb_srfs),
    folder=output_directory,
    name=toplayer,
    write=runradiancefilegeneration)  # -> report, outputs; plug-in component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
createbat = GhPythonScript(HB_report=runradiance.report)  # -> command; inputs HB_report: list
# ---------- createbat: Python ----------
import os

# Base path for batch file
base_path = os.path.dirname(HB_report[3].replace("Writing recipe contents to: ", ""))
_batPath = os.path.join(base_path, "run_radiance.bat")
ref_bat_path = os.path.join(base_path, "gridbased_annual", "commands.bat")

# Write BAT file
with open(_batPath, "w") as f:
    f.write(ref_bat_path)

command = ref_bat_path
# ---------- end createbat ----------

# ----
runeplusfilegeneration = Boolean(toggle_7)
skypatchdensity = Panel("0")
toggle_8 = BooleanToggle(False)  # disabled
panel_2 = Panel("3")  # disabled
toggle_9 = BooleanToggle(True)  # disabled

# ---- group: Generate EnergyPlus surface temperature model
toggle_10 = BooleanToggle(False)
simcontrol = Honeybee_SimulationControl(
    doZoneSizingCalculation=toggle_10,
    doSystemSizingCalculation=toggle_10,
    doPlantSizingCalculation=toggle_10,
    runSimForSizingPeriods=toggle_10,
    runSimForRunPeriods=Toggle(True))  # -> simControls; plug-in component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
importgroundtemp = Ladybug_ImportGroundTemp(epwFile=weatherfile)  # -> readMe, groundtemp1st, groundtemp2nd, groundtemp3rd, profileCrvs, crvColors, graphAxes, graphtext, Legend; plug-in component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
shadowpar = Honeybee_ShadowPar(calculationMethod="TimestepFrequency", frequency="1", maximumFigure="1000")  # -> shadowPar; plug-in component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
panel_3 = Panel("""OutputControl:Table:Style,Comma;
Output:Variable,*,Surface Outside Face Temperature, hourly;
Output:Diagnostics,DisplayExtraWarnings;""")
strnum = Ladybug_SeparateData(inputList=flatten(importgroundtemp.groundtemp1st))  # -> numbers, strings; plug-in component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
panel_4 = Panel("0")
energysimpar = Honeybee_EnergySimulationPar(
    timestep=6,
    shadowCalcPar=shadowpar,
    solarDistribution="3",
    simulationControls=simcontrol,
    terrain=panel_4,
    monthlyGrndTemps=strnum.numbers)  # -> energySimPar; plug-in component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
exporttoopenstudio = Honeybee_ExportToOpenStudio(
    epwWeatherFile=weatherfile,
    energySimPar=energysimpar,
    HBZones=flatten(hbzones),
    HBContext=flatten(hbcontext),
    simulationOutputs=flatten(panel_3),
    writeOSM=runeplusfilegeneration,
    runSimulation="3",
    fileName=toplayer,
    workingDir=output_directory)  # -> readMe, osmFileAddress, idfFileAddress, resultFileAddress, eioFileAddress, rddFileAddress, htmlReport, studyFolder, model; plug-in component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

# ----
modifygrass_underground = GhPythonScript(originalFile=exporttoopenstudio.idfFileAddress, rewrite=Toggle(True))  # -> idfAddress; inputs rewrite: Boolean
# ---------- modifygrass_underground: Python ----------
import os, re

# Read original file
with open(_originalFile, "r") as f:
    data = f.read()

# Replace whitespace between values and comments
test = re.sub("\s+!", "!", data)

# Replace grass material
test = re.sub(
    "Material,\n  GND_GRASS,!- Name\n  Rough,!- Roughness\n  0.2,!- Thickness {m}\n  1,!- Conductivity {W/m-K}\n  1250,!- Density {kg/m3}\n  1252,!- Specific Heat {J/kg-K}\n  0.92,!- Thermal Absorptance\n  0.75,!- Solar Absorptance\n  0.7;!- Visible Absorptance", 
    "Material:RoofVegetation,\n  GND_GRASS,!- Name\n  0.05,!- Height of Plants\n  1.71,!- Leaf Area Index\n  0.19,!- Leaf Reflectivity\n  0.95,!- Leaf Emissivity\n  180,!- Minimum Stomatal Resistance\n  Soil,!- Soil Layer Name\n  Rough,!- Roughness\n  0.2,!- Thickness\n  1,!- Conductivity of Dry Soil\n  1250,!- Density of Dry Soil\n  1252,!- Specific Heat of Dry Soil\n  0.92,!- Thermal Absorptance\n  0.75,!- Solar Absorptance\n  0.75,!- Visible Absorptance\n  0.3,!- Saturation Volumetric Moisture Content of the Soil Layer\n  0.01,!- Residual Volumetric Moisture Content of the Soil Layer\n  0.1,!- Initial Volumetric Moisture Content of the Soil Layer\n  Simple;!- Moisture Diffusion Calculation Method", 
    test
)

# Make underground surfaces ground-adjacent
test = re.sub(
    "  GND_SURROUNDING,!- Construction Name\n  GROUND_ZONE,!- Zone Name\n  Outdoors,!- Outside Boundary Condition\n  ,!- Outside Boundary Condition Object\n  Nosun,!- Sun Exposure\n  Nowind,!- Wind Exposure", 
    "  GND_SURROUNDING,!- Construction Name\n  GROUND_ZONE,!- Zone Name\n  Ground,!- Outside Boundary Condition\n  ,!- Outside Boundary Condition Object\n  Nosun,!- Sun Exposure\n  Nowind,!- Wind Exposure", 
    test
)
test = re.sub(
    "  GND_SURROUNDING,!- Construction Name\n  GROUND_ZONE,!- Zone Name\n  Outdoors,!- Outside Boundary Condition\n  ,!- Outside Boundary Condition Object\n  Sunexposed,!- Sun Exposure\n  Windexposed,!- Wind Exposure", 
    "  GND_SURROUNDING,!- Construction Name\n  GROUND_ZONE,!- Zone Name\n  Ground,!- Outside Boundary Condition\n  ,!- Outside Boundary Condition Object\n  Nosun,!- Sun Exposure\n  Nowind,!- Wind Exposure", 
    test
)

# Rewrite the IDF file
if _rewrite:
    with open(_originalFile, "w") as f:
        f.write(test)
    idfAddress = _originalFile
# ---------- end modifygrass_underground ----------

# ---- group: Generate EnergyPlus surface temperature model (continued)
createbat_2 = GhPythonScript(epwPath=weatherfile, eplusPath=e_executable_path, idfPath=modifygrass_underground)  # -> command
# ---------- createbat_2: Python ----------
import rhinoscriptsyntax as rs
import os, json

# Create EnergyPlus run command
#idf_path = os.path.join(_outputDir, _caseName, "OpenStudio", _caseName, "ModelToIdf", "in.idf").replace("\\", "/")
#idf_output_dir = os.path.join(_outputDir, _caseName, "OpenStudio", _caseName, "ModelToIdf").replace("\\", "/")
#eplus_output_path = os.path.join(_outputDir, _caseName, "OpenStudio", _caseName, "ModelToIdf", "eplusout.csv").replace("\\", "/")
#eplus_command = '"{0:}" -a -r -x -d "{3:}" -w "{1:}" "{2:}"'.format(_eplusPath.replace("\\", "/"), _epwFile, idf_path, idf_output_dir)

# Base path for batch file
bat_dir = os.path.dirname(os.path.dirname(os.path.dirname(os.path.dirname(_idfPath))))
_batPath = os.path.join(bat_dir, "run_eplus.bat")

# Output directory for eplus run
eplus_out_dir = os.path.dirname(_idfPath)

# Command string to write to BAT
eplus_command = '"{0:}" -a -r -x -d "{3:}" -w "{1:}" "{2:}"'.format(_eplusPath, _epwPath, _idfPath, eplus_out_dir).replace("\\", "/")

# Write BAT file
with open(_batPath, "w") as f:
    f.write(eplus_command)

command = eplus_command
# ---------- end createbat_2 ----------

# ----
logicpause = GhPythonScript(x=createbat_2, y=createbat)  # -> a, b
# ---------- logicpause: Python ----------
a = 1
b = "Verdana"
# ---------- end logicpause ----------

# ---- group: TESTING GROUP FOR DODGY GEOMETRY!
# TEST SPACE FOR
# DODGY GROUND
# GEOMETRY
toggle_11 = BooleanToggle(False)  # disabled
panel_5 = Panel("AverageOverDaysInFrequency")  # disabled
panel_6 = Panel("365")  # disabled
panel_7 = Panel("200")  # disabled
simcontrol_2 = Honeybee_SimulationControl(
    doZoneSizingCalculation=toggle_11,
    doSystemSizingCalculation=toggle_11,
    doPlantSizingCalculation=toggle_11,
    runSimForSizingPeriods=toggle_8,
    runSimForRunPeriods=toggle_11)  # -> simControls; disabled; plug-in component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
shadowpar_2 = Honeybee_ShadowPar(calculationMethod=panel_5, frequency=panel_6, maximumFigure=panel_7)  # -> shadowPar; disabled; plug-in component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
panel_8 = Panel("4")  # disabled
panel_9 = Panel("0")  # disabled
panel_10 = Panel("Output:Diagnostics,DisplayExtraWarnings;")  # disabled
energysimpar_2 = Honeybee_EnergySimulationPar(
    timestep=panel_8,
    shadowCalcPar=shadowpar_2,
    solarDistribution=panel_9,
    simulationControls=simcontrol_2,
    terrain=panel_4,
    monthlyGrndTemps=strnum.numbers)  # -> energySimPar; disabled; plug-in component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
panel_11 = Panel("5")  # disabled
toggle_12 = BooleanToggle(True)  # disabled
panel_12 = Panel("19")  # disabled
panel_13 = Panel("12")  # disabled
analysisperiod = Ladybug_AnalysisPeriod(fromMonth=panel_11, fromDay=panel_13, toMonth=panel_11, toDay=panel_12)  # -> readMe, analysisPeriod; disabled; plug-in component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
exporttoopenstudio_2 = Honeybee_ExportToOpenStudio(
    epwWeatherFile=weatherfile,
    analysisPeriod=analysisperiod.analysisPeriod,
    energySimPar=energysimpar_2,
    HBZones=flatten(hbzones),
    HBContext=flatten(hbcontext),
    simulationOutputs=flatten(panel_3),
    additionalStrings=flatten(panel_10),
    writeOSM=toggle_12,
    runSimulation=panel_2)  # -> readMe, osmFileAddress, idfFileAddress, resultFileAddress, eioFileAddress, rddFileAddress, htmlReport, studyFolder, model; disabled; plug-in component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
readepsrfresult = Honeybee_ReadEPSurfaceResult(resultFileAddress=exporttoopenstudio_2.resultFileAddress)  # -> port, surfaceOutdoorTemp, port_2, port_3, port_4, port_5, port_6, port_7, port_8; disabled; plug-in component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
panel_14 = Panel("8959")  # disabled
partition = PartitionList(List=flatten(readepsrfresult.surfaceOutdoorTemp), Size=panel_14)  # -> simplify(Chunks); disabled
viewer = ParamViewer(partition)  # disabled

# ---- group: Calculate point/surface view factors
hbzones_2 = Data(hbzones)
labelzones = Honeybee_LabelZones(HBZones=flatten(hbzones_2), attribute="name", font=logicpause.b)  # -> zoneTxtLabels, labelBasePts, brepTxtLabels, zoneWireFrames; plug-in component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
tsort = SortText(Keys=labelzones.zoneTxtLabels, Values=hbzones_2, Culture=127)  # -> Keys, Values
debrep_2 = DeconstructBrep(Brep=tsort.Values)  # -> flatten(Faces), Edges, Vertices
srfviewfactors = Ladybug_SurfaceViewAnalysis(
    testPtsOrPlanes=flatten(analysispoints),
    testSrfs=debrep_2.Faces,
    context=hbcontext,
    viewResolution=skypatchdensity,
    parallel=Toggle(True),
    runIt=Toggle(True))  # -> readMe, srfViewFactors, viewVecSrfIndex, viewVectors, viewPatches, viewPatchBasePt; plug-in component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
lng_5 = ListLength(List=debrep_2.Faces)
split_2 = SplitList(List=srfviewfactors.srfViewFactors, Index=lng_5)  # -> simplify(ListA), simplify(ListB)
shading_surface_view_factors = Data(split_2.ListB)
surface_view_factors = Data(split_2.ListA)

# ---- group: Calculate point/sky view-factors
shadingmask = Ladybug_ShadingMask(centerPtOrPlane=analysispoints, context=hbcontext, scale=logicpause.a)  # -> contextMask, orientationMask, strategyMask, skyMask, port, contextExposure, orientExposure, strategyExposure, skyExposure; plug-in component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
ptskyexposure = Data(shadingmask.skyExposure)

# ----
createbat_recipe = GhPythonScript(
    epwFile=weatherfile,
    outputDir=output_directory,
    caseName=toplayer,
    samplePoints=analysispoints,
    boundaryPoints=boundarypoints,
    groundReflectivities=groundsurfacereflectivities,
    skyViewFactors=ptskyexposure,
    srfViewFactors=surface_view_factors)  # inputs samplePoints: list of Point3d, boundaryPoints: list of Point3d, groundReflectivities: list, skyViewFactors: list, srfViewFactors: tree
# ---------- createbat_recipe: Python ----------
__author__ = "tgerrish"
__version__ = "2020.03.17"

import rhinoscriptsyntax as rs
import os, json

# Copy epw file to local directory
os.system('copy {0:} {1:}'.format(_epwFile, os.path.join(_outputDir, _caseName, os.path.basename(_epwFile))))

# Define Radiance result directory
radiance_result_directory = os.path.join(_outputDir, _caseName, "gridbased_annual", "result").replace("\\", "/")

# Generate the JSON recipe for processing in pure Python
d = {}

# EPW file
d["epw"] = os.path.join(_outputDir, _caseName, os.path.basename(_epwFile)).replace("\\", "/")

# Add surface view factors
d["surface_view_factors"] = [[j for j in _srfViewFactors.Branch(i)] for i in range(_srfViewFactors.BranchCount)]

# Add sky view factors
d["sky_view_factors"] = _skyViewFactors

# Add ground reflectivieis
d["ground_reflectivities"] = _groundReflectivities

# Path to radiance results
d["radiation_results"] = radiance_result_directory

# XYZ locations
d["points"] = [[i.X, i.Y, i.Z] for i in _samplePoints]

# Boundary points
d["boundary"] = [[i.X, i.Y, i.Z] for i in _boundaryPoints]

# Energyplus surface temperatures
d["eplus_results"] = os.path.join(_outputDir, _caseName, "OpenStudio", _caseName, "ModelToIdf", "eplusout.csv").replace("\\", "/")

# Output recipe
if (len(_skyViewFactors) != 0) & (_srfViewFactors.BranchCount != 0):
    output_path = os.path.join(_outputDir, _caseName, "recipe.json").replace("\\", "/")
    with open(output_path, "w") as f:
        json.dump(d, f)
# ---------- end createbat_recipe ----------
python_11 = GhPythonScript(originalFile=exporttoopenstudio_2.idfFileAddress, rewrite=toggle_9)  # -> idfAddress; inputs rewrite: Boolean; disabled
# ---------- python_11: Python ----------
import os, re

# Read original file
with open(_originalFile, "r") as f:
    data = f.read()

# Replace whitespace between values and comments
test = re.sub("\s+!", "!", data)

# Replace grass material
test = re.sub(
    "Material,\n  GND_GRASS,!- Name\n  Rough,!- Roughness\n  0.2,!- Thickness {m}\n  1,!- Conductivity {W/m-K}\n  1250,!- Density {kg/m3}\n  1252,!- Specific Heat {J/kg-K}\n  0.92,!- Thermal Absorptance\n  0.75,!- Solar Absorptance\n  0.7;!- Visible Absorptance", 
    "Material:RoofVegetation\n  GND_GRASS,!- Name\n  0.05,!- Height of Plants\n  1.71,!- Leaf Area Index\n  0.19,!- Leaf Reflectivity\n  0.95,!- Leaf Emissivity\n  180,!- Minimum Stomatal Resistance\n  Soil,!- Soil Layer Name\n  Rough,!- Roughness\n  0.2,!- Thickness\n  1,!- Conductivity of Dry Soil\n  1250,!- Density of Dry Soil\n  1252,!- Specific Heat of Dry Soil\n  0.92,!- Thermal Absorptance\n  0.75,!- Solar Absorptance\n  0.75,!- Visible Absorptance\n  0.3,!- Saturation Volumetric Moisture Content of the Soil Layer\n  0.01,!- Residual Volumetric Moisture Content of the Soil Layer\n  0.1,!- Initial Volumetric Moisture Content of the Soil Layer\n  Simple;!- Moisture Diffusion Calculation Method", 
    test
)

# Make underground surfaces ground-adjacent
test = re.sub(
    "  GND_SURROUNDING,!- Construction Name\n  GROUND_ZONE,!- Zone Name\n  Outdoors,!- Outside Boundary Condition\n  ,!- Outside Boundary Condition Object\n  Nosun,!- Sun Exposure\n  Nowind,!- Wind Exposure", 
    "  GND_SURROUNDING,!- Construction Name\n  GROUND_ZONE,!- Zone Name\n  Ground,!- Outside Boundary Condition\n  ,!- Outside Boundary Condition Object\n  Nosun,!- Sun Exposure\n  Nowind,!- Wind Exposure", 
    test
)
test = re.sub(
    "  GND_SURROUNDING,!- Construction Name\n  GROUND_ZONE,!- Zone Name\n  Outdoors,!- Outside Boundary Condition\n  ,!- Outside Boundary Condition Object\n  Sunexposed,!- Sun Exposure\n  Windexposed,!- Wind Exposure", 
    "  GND_SURROUNDING,!- Construction Name\n  GROUND_ZONE,!- Zone Name\n  Ground,!- Outside Boundary Condition\n  ,!- Outside Boundary Condition Object\n  Nosun,!- Sun Exposure\n  Nowind,!- Wind Exposure", 
    test
)

# Rewrite the IDF file
if _rewrite:
    with open(_originalFile, "w") as f:
        f.write(test)
    idfAddress = _originalFile
# ---------- end python_11 ----------
panel_15 = Panel(python_11)  # disabled
createbat_3 = GhPythonScript(epwPath=weatherfile, eplusPath=e_executable_path, idfPath=exporttoopenstudio_2.idfFileAddress)  # -> command; disabled; same code as createbat_2
panel_16 = Panel(createbat_3)  # disabled

# ==== cluster Cluster
layername = ClusterInput()
toplayer = ClusterInput()
layername_2 = Data(layername)
toplayer_2 = Data(toplayer)
concat = Concatenate(FragmentA=toplayer_2, FragmentC="::", FragmentB=layername_2)
dpipeline = DynamicGeometryPipeline(
    LayerFilter=concat,
    TypeFilter="Brep",
    NameFilter="*",
    GroupByLayer=False,
    GroupByType=False,
    IncludeHidden=True,
    IncludeLocked=True,
    enableFullPath=True,
    listenToAttributes=True)  # -> simplify(flatten(GeometryOut))
debrep = DeconstructBrep(Brep=dpipeline)  # -> flatten(Faces), Edges, Vertices
lng = ListLength(List=debrep.Faces)
series = Series(Start=0, Step=1, Count=lng)
concat_2 = Concatenate(FragmentA=layername_2, FragmentB=series)
surfacenames = Data(concat_2)
surfaces = Surface(debrep.Faces)
surfacenames_2 = ClusterOutput(surfacenames)
surfaces_2 = ClusterOutput(surfaces)

# ==== cluster Cluster_2
surfaces = ClusterInput()
surfaces_2 = Surface(surfaces)
project = Project(Geometry=surfaces_2, Plane=PlaneXY(0, 0, 0))  # -> Geometry, Transform
area = Area(Geometry=project.Geometry)  # -> Area, Centroid
smaller = SmallerThan(FirstNumber=area.Area, SecondNumber="0.0001")  # -> SmallerThan, OrEqualTo
dispatch = Dispatch(List=surfaces_2, DispatchPattern=smaller.SmallerThan)  # -> ListA, ListB
edges = BrepEdges(Brep=dispatch.ListB)  # -> Naked, Interior, NonManifold
join = JoinCurves(Curves=edges.Naked, Preserve=False)
explode = Explode(Curve=join, Recursive=True)  # -> Segments, simplify(Vertices)
shift = ShiftList(List=explode.Vertices, Shift=1, Wrap=False)
short = ShortestList(ListA=explode.Vertices, ListB=shift, TrimMode=2)  # -> ListA, ListB
item = ListItem(List=short.ListA, Index=0, Wrap=True)  # -> Item, Item1
item_2 = ListItem(List=short.ListB, Index=0, Wrap=True)  # -> Item, Item1
vec2pt = Vector2Pt(PointA=item.Item, PointB=item_2.Item, Unitize=False)  # -> Vector, Length
vec2pt_2 = Vector2Pt(PointA=item.Item1, PointB=item_2.Item1, Unitize=False)  # -> Vector, Length
Z = UnitZ(Factor=1)
xprod = CrossProduct(VectorA=vec2pt.Vector, VectorB=vec2pt_2.Vector, Unitize=False)  # -> Vector, Length
cset = CreateSet(List=explode.Vertices)  # -> Set, Map
dprod = DotProduct(VectorA=xprod.Vector, VectorB=Z, Unitize=True)
larger = LargerThan(FirstNumber=dprod, SecondNumber=0)  # -> LargerThan, OrEqualTo
rev = ReverseList(List=cset.Set)
cull = CullPattern(List=rev, CullPattern=invert(larger.LargerThan))
cull_2 = CullPattern(List=cset.Set, CullPattern=larger.LargerThan)
merge = Merge(Data1=cull_2, Data2=cull)
pline = PolyLine(Vertices=merge, Closed=Toggle(True))
boundaries = Data(flatten(pline))
boundaries_2 = ClusterOutput(boundaries)

# ==== cluster Cluster_3
solarabsorptivity = ClusterInput()
solarabsorptivity_2 = Data(solarabsorptivity)
subtraction = Subtraction(A="1", B=solarabsorptivity_2)
reflectivity = Data(subtraction)
reflectivity_2 = ClusterOutput(reflectivity)

# ==== cluster Cluster_4
layername = ClusterInput()
toplayer = ClusterInput()
layername_2 = Data(layername)
toplayer_2 = Data(toplayer)
concat = Concatenate(FragmentA=toplayer_2, FragmentC="::", FragmentB=layername_2)
dpipeline = DynamicGeometryPipeline(
    LayerFilter=concat,
    TypeFilter="Brep",
    NameFilter="*",
    GroupByLayer=False,
    GroupByType=False,
    IncludeHidden=True,
    IncludeLocked=True,
    enableFullPath=True,
    listenToAttributes=True)  # -> simplify(flatten(GeometryOut))
lng = ListLength(List=dpipeline)
series = Series(Start=0, Step=1, Count=lng)
concat_2 = Concatenate(FragmentA=layername_2, FragmentB=series)
brepnames = Data(concat_2)
brep = Brep(dpipeline)
brepnames_2 = ClusterOutput(brepnames)
brep_2 = ClusterOutput(brep)
